test file "MegAWES_Test"

suite "Test Suite"
  description: Perform safety checks to verify that:
    - Max tether force is not violated

  case "Windspeed 8" [baseline]
    model Dyn_6DoF_v2_0_r2019b
    pre-load callback:
      %% Startup/Set cache folder
      addpath(['Src' filesep 'Common'])
      PreSim_startup();

      Kite_DOF = 6;
      windspeed = 8;

      [act, base_windspeed, constr, DE2019, ENVMT, Lbooth, ...
      	loiterStates, params, simInit, T, winchParameter] = ...
      	Get_simulation_params(windspeed, Kite_DOF);

      constr.F_T_max = inf;

  case "Windspeed 10" [baseline]
    model Dyn_6DoF_v2_0_r2019b
    pre-load callback:
      %% Startup/Set cache folder
      addpath(['Src' filesep 'Common'])
      PreSim_startup();

      Kite_DOF = 6;
      windspeed = 10;

      [act, base_windspeed, constr, DE2019, ENVMT, Lbooth, ...
      	loiterStates, params, simInit, T, winchParameter] = ...
      	Get_simulation_params(windspeed, Kite_DOF);

      constr.F_T_max = inf;

  case "Windspeed 14" [baseline]
    model Dyn_6DoF_v2_0_r2019b
    pre-load callback:
      %% Startup/Set cache folder
      addpath(['Src' filesep 'Common'])
      PreSim_startup();

      Kite_DOF = 6;
      windspeed = 14;

      [act, base_windspeed, constr, DE2019, ENVMT, Lbooth, ...
      	loiterStates, params, simInit, T, winchParameter] = ...
      	Get_simulation_params(windspeed, Kite_DOF);

      constr.F_T_max = inf;

  case "Windspeed 16" [baseline]
    model Dyn_6DoF_v2_0_r2019b
    pre-load callback:
      %% Startup/Set cache folder
      addpath(['Src' filesep 'Common'])
      PreSim_startup();

      Kite_DOF = 6;
      windspeed = 16;

      [act, base_windspeed, constr, DE2019, ENVMT, Lbooth, ...
      	loiterStates, params, simInit, T, winchParameter] = ...
      	Get_simulation_params(windspeed, Kite_DOF);

      constr.F_T_max = inf;

  case "Windspeed 18" [baseline]
    model Dyn_6DoF_v2_0_r2019b
    pre-load callback:
      %% Startup/Set cache folder
      addpath(['Src' filesep 'Common'])
      PreSim_startup();

      Kite_DOF = 6;
      windspeed = 18;

      [act, base_windspeed, constr, DE2019, ENVMT, Lbooth, ...
      	loiterStates, params, simInit, T, winchParameter] = ...
      	Get_simulation_params(windspeed, Kite_DOF);

      constr.F_T_max = inf;

  case "Windspeed 20" [baseline]
    model Dyn_6DoF_v2_0_r2019b
    pre-load callback:
      %% Startup/Set cache folder
      addpath(['Src' filesep 'Common'])
      PreSim_startup();

      Kite_DOF = 6;
      windspeed = 20;

      [act, base_windspeed, constr, DE2019, ENVMT, Lbooth, ...
      	loiterStates, params, simInit, T, winchParameter] = ...
      	Get_simulation_params(windspeed, Kite_DOF);

      constr.F_T_max = inf;

  case "Windspeed 22" [baseline]
    model Dyn_6DoF_v2_0_r2019b
    pre-load callback:
      %% Startup/Set cache folder
      addpath(['Src' filesep 'Common'])
      PreSim_startup();

      Kite_DOF = 6;
      windspeed = 22;

      [act, base_windspeed, constr, DE2019, ENVMT, Lbooth, ...
      	loiterStates, params, simInit, T, winchParameter] = ...
      	Get_simulation_params(windspeed, Kite_DOF);

      constr.F_T_max = inf;

  case "Windspeed 25" [baseline]
    model Dyn_6DoF_v2_0_r2019b
    pre-load callback:
      %% Startup/Set cache folder
      addpath(['Src' filesep 'Common'])
      PreSim_startup();

      Kite_DOF = 6;
      windspeed = 25;

      [act, base_windspeed, constr, DE2019, ENVMT, Lbooth, ...
      	loiterStates, params, simInit, T, winchParameter] = ...
      	Get_simulation_params(windspeed, Kite_DOF);

      constr.F_T_max = inf;

  case "Windspeed 28" [baseline]
    model Dyn_6DoF_v2_0_r2019b
    pre-load callback:
      %% Startup/Set cache folder
      addpath(['Src' filesep 'Common'])
      PreSim_startup();

      Kite_DOF = 6;
      windspeed = 28;

      [act, base_windspeed, constr, DE2019, ENVMT, Lbooth, ...
      	loiterStates, params, simInit, T, winchParameter] = ...
      	Get_simulation_params(windspeed, Kite_DOF);

      constr.F_T_max = inf;

  case "Windspeed 30" [baseline]
    model Dyn_6DoF_v2_0_r2019b
    pre-load callback:
      %% Startup/Set cache folder
      addpath(['Src' filesep 'Common'])
      PreSim_startup();

      Kite_DOF = 6;
      windspeed = 30;

      [act, base_windspeed, constr, DE2019, ENVMT, Lbooth, ...
      	loiterStates, params, simInit, T, winchParameter] = ...
      	Get_simulation_params(windspeed, Kite_DOF);

      constr.F_T_max = inf;